# Grasshopper definition WanderingCurves.gh (Grasshopper 0.9.76)
# plug-ins: Heteroptera, Anemone

# FIRST
# MIDDLE
# LAST
# Points on a line.
# Set FIRST and LAST Point of Line.
pt = Point(Point(0, 0, 0))
pt_2 = Point(Point(100, 0, 0))
# Number of points on the line.
panel = Panel("128")
# Set the Line.
line = Line(Line((0, 0, 0), (100, 0, 0)))
# I have a built in timer, right click to change my speed.
panel_2 = Panel("127")
wandering = WanderingVector(Likelihood="0.8", Steps="40", Number=panel_2, referenceAll=0)
divide = DivideCurve(Curve=line, Count=panel, Kinks=False)  # -> Points, Tangents, Parameters
devec = DeconstructVector(Vector=wandering)  # -> XComponent, YComponent, ZComponent
vec = VectorXYZ(XComponent=0, YComponent=devec.YComponent, ZComponent=0)  # -> Vector, Length
cull_i = CullIndex(List=divide.Points, Indices=[panel, "0"], Wrap=True)  # -> reverse(List)
pt_3 = Point(cull_i)
panel_3 = Panel("Tweak Me.")
multiplication = Multiplication(A=vec.Vector, B="1.6")
move = Move(Geometry=pt_3, Motion=multiplication)  # -> Geometry, Transform
pt_4 = Point(flatten([pt, move.Geometry, pt_2]))
# If your curves get loopy, try changing the shift offset.
toggle = BooleanToggle(True)
# Curve or Polyline if you like.
shift = ShiftList(List=pt_4, Shift=Toggle(True), Wrap=toggle)
pline = PolyLine(Vertices=shift, Closed=False)
intcrv = Interpolate(Vertices=shift, Degree=3, Periodic=False, KnotStyle=0)  # -> Curve, Length, Domain
# Start and Stop recording curves here.
rec = DataRecorder(intcrv.Curve, DataLimit=-10, RecordData=True)
# Trigger when you're ready for the loop.
dam = DataDam(DataA=rec, BufferDelay=10000000, BufferMode=0)
crv = Curve(dam)
lng = ListLength(List=crv)
# Loop seperates curves laterally by specified distance.
# Disabled for performance.
loop_start = LoopStart(Repeat=lng, Trigger=Toggle(True), Data=crv)  # -> port, Counter, Data
# Record wandering curves first, then enable this loop and use the toggle to restart.
panel_4 = Panel(loop_start.Counter)
item = ListItem(List=loop_start.Data, Index=panel_4, Wrap=True)
# Distance to seperate each curve laterally.
panel_5 = Panel("5")
multiplication_2 = Multiplication(A=panel_4, B=panel_5)
vec_2 = VectorXYZ(XComponent=0, YComponent=0, ZComponent=multiplication_2)  # -> Vector, Length
move_2 = Move(Geometry=item, Motion=vec_2.Vector)  # -> Geometry, Transform
# Records the laterally seperated wandering curves.
rec_2 = DataRecorder(move_2.Geometry, DataLimit=-10, RecordData=True)
loop_end = LoopEnd(port=loop_start.port, Exit=False, Data=loop_start.Data, pausedState=False, state="Constant output", TimeOutVal=0)
crv_2 = Curve(rec_2)
